# Grasshopper definition 0_Urban_Analysis.gh (Grasshopper 1.0.7)
# plug-ins: ElkGHComponents, LunchBox, Wombat

swatch = ColourSwatch(SwatchColor=RGB(255, 255, 255))
canvas_color = CanvasColor(Toggle=Toggle(True), BackgroundColor=swatch, GridColor=swatch)

rehabilitation = Slider(2, range=0..50, expression="x*0.1")
operation = Slider(2, range=0..50, expression="x*0.1")
women_s = Slider(2, range=0..50, expression="x*0.1")
primary = Slider(3, range=0..50, expression="x*0.1")
dental = Slider(1, range=0..50, expression="x*0.1")
wards = Slider(15, range=0..50, expression="x*0.10")
division = Division(A=wards, B=2)
merge = Merge(Data1=division, Data2=primary, Data3=women_s, Data4=dental, Data5=rehabilitation, Data6=operation)

# ---- group: Setting up base data / Data is internalized
osm_file = FilePath("C:\Users\jan_d\OneDrive\Documenten\Collegejaar '21-'22\AR3B011 EARTHY\Deliverables\1_Configuration\Data\Zaatari Camp.osm")
loc = Location(FilePathText=osm_file)  # -> OSMPointData, OSMFile, LongitudeDomain, LatitudeDomain
population = Panel("""5537
6432
4166
4007
5086
6634
5917
7929
4801
5332
7178
5193""")
ma = MassAddition(Input=population)  # -> Result, PartialResults
total_population = Panel(ma.Result)
osm = OSMData(OSMPointData=loc.OSMPointData, OSMFilePath=loc.OSMFile, Feature="highway", Generate3d=False, IndividualOutputs=False)  # -> Ways, FeatureKey
osm_2 = OSMData(OSMPointData=loc.OSMPointData, OSMFilePath=loc.OSMFile, Feature="amenity", Generate3d=False, IndividualOutputs=False)  # -> Ways, FeatureKey

# ---- group: Setting up base data / Curve cleanup
secondary_roads = Curve([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])
primary_roads = Curve([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])
access_routes = Curve([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])
pline = PolyLine(Vertices=osm.Ways, Closed=False)
perimeter = Curve(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)
districts = Curve([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])
area = Area(Geometry=districts)  # -> Area, Centroid
camp = Surface(perimeter)
points = PointList(Points=area.Centroid, Size=Slider(100000, range=0..100000))

# ---- group: Setting up base data
hospitals_s = Curve([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])
hospitals_l = Curve([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])
pline_2 = PolyLine(Vertices=osm_2.Ways, Closed=True)
buildings = Curve([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])
srf = Surface(buildings)
srf_2 = Surface(hospitals_s)
srf_3 = Surface(hospitals_l)

merge_2 = Merge(Data1=buildings, Data2=hospitals_s, Data3=hospitals_l)

# ----
# Find location:
galapagos = Galapagos(fitness=ma_2, gene=[number_slider, number_slider_2])
small_large = BooleanToggle(True)

# ----
# Preview toolbox:
swatch_2 = ColourSwatch(SwatchColor=RGB(100, 100, 100))
swatch_3 = ColourSwatch(SwatchColor=RGB(42, 148, 255))
secondary_roads_2 = Curve(secondary_roads)
primary_roads_2 = Curve(primary_roads)
access_roads = Curve(access_routes)
# User interface
perimeter_2 = Curve(perimeter)
districts_2 = Curve(districts)
buildings_2 = CustomPreview(Geometry=srf, Material=swatch_2)
hospitals = CustomPreview(Geometry=[srf_3, srf_2], Material=swatch_2)

# ---- group: Primary infrastructure
# Multi-criteria analysis toolbox:
primary_road_density = Slider(50000, range=10000..100000)

# ---- group: Primary roads
density_slider = Data(primary_road_density)
primary_roads_3 = Curve(primary_roads)
len = Length(Curve=primary_roads_3)
division_2 = Division(A=len, B=density_slider)
divide = DivideCurve(Curve=primary_roads_3, Count=division_2, Kinks=False)  # -> Points, Tangents, Parameters
pt = Point(divide.Points)

# ---- group: Primary infrastructure (continued)
pt_2 = Point(pt)

# ---- group: Proximity to access gates
access_gate_density = Slider(16, range=1..100)
access_gate_radius_m = Slider(500, range=100..1000)

# ---- group: Unserviced areas
service_density = Slider(47, range=0..100)
hospital_radius_s_m = Slider(250, range=50..500)
hospital_radius_l_m = Slider(500, range=100..1000)

# ---- group: Serviced area
hospital_radius_l_m_slider = Data(hospital_radius_l_m)
hospital_radius_s_m_slider = Data(hospital_radius_s_m)
service_density_slider = Data(service_density)
hospitals_l_2 = Surface(srf_3)
hospitals_s_2 = Surface(srf_2)
perimeter_3 = Curve(perimeter)
area_2 = Area(Geometry=hospitals_s_2)  # -> Area, Centroid
area_3 = Area(Geometry=hospitals_l_2)  # -> Area, Centroid
sdivide = DivideSurface(Surface=perimeter_3, UCount=service_density_slider, VCount=service_density_slider)  # -> flatten(Points), Normals, Parameters
cir = Circle(Plane=area_2.Centroid, Radius=expr("1000*x", hospital_radius_s_m_slider))
cir_2 = Circle(Plane=area_3.Centroid, Radius=expr("1000*x", hospital_radius_l_m_slider))
clean = CleanTree(RemoveNulls=True, RemoveInvalid=True, RemoveEmpty=False, Tree=sdivide.Points)
merge_3 = Merge(Data1=cir, Data2=cir_2)
incurves = PointInCurves(Point=clean, Curves=merge_3)  # -> Relationship, Index, Point
expression = Expression(occupied=incurves.Relationship, Expression="if (occupied=0,True,False)")
cull = CullPattern(List=clean, CullPattern=expression)
pt_3 = Point(cull)

# ---- group: Unserviced areas (continued)
pt_4 = Point(pt_3)

# ----
hospital_range_l = Curve(cir_2)
hospital_range_s = Curve(cir)

# ---- group: Population density by district
population_density = Slider(22, range=1..100)

# ----
path = FilePath("C:\Users\jan_d\OneDrive\Documenten\Collegejaar '21-'22\AR3B011 EARTHY\Deliverables\1_Configuration\Data\1_Configuration_Data.xlsx")

# ---- group: Stop further computing
# The stream block simply stops the heavier downstream components from running until deactivated.
# This allows you to tweak the point cloud parameters much smoother and faster, until you are satisfied.
# Unblock to continue the analysis.
stream_block = BooleanToggle(False)
filter = StreamFilter(Gate=stream_block, Stream1="WARNING: stream block activated")
tag = TextTag(Location=Point(4881450.847, 3922039.279, 0), Text=filter)

# ---- group: Access gates
access_gate_density_slider = Data(access_gate_density)
radius_slider = Data(access_gate_radius_m)
access_routes_2 = Curve(access_routes)
end = EndPoints(Curve=access_routes_2)  # -> Start, End
access_gates = Point(graft(end.Start))
cir_3 = Circle(Plane=access_gates, Radius=expr("1000*x", radius_slider))
srf_4 = Surface(cir_3)
sdivide_2 = DivideSurface(Surface=srf_4, UCount=access_gate_density_slider, VCount=access_gate_density_slider)  # -> simplify(Points), Normals, Parameters
path_mapper = PathMapper(sdivide_2.Points, source="{A;B}", target="{A;0}")
clean_2 = CleanTree(RemoveNulls=True, RemoveInvalid=True, RemoveEmpty=False, Tree=path_mapper)
vec2pt = Vector2Pt(PointA=clean_2, PointB=access_gates, Unitize=False)  # -> Vector, Length
sort = SortList(Keys=vec2pt.Length)  # -> reverse(Keys), ValuesA
item = ListItem(List=sort.Keys, Index=0, Wrap=True)
remap = RemapNumbers(Value=vec2pt.Length, Source=item, Target=Domain(0, 1))  # -> Mapped, Clipped
perimeter_4 = Curve(perimeter)

# ---- group: Proximity to access gates (continued)
central_proximity_distribution = GraphMapper(
    remap.Mapped,
    x0=0,
    x1=1,
    y0=0,
    y1=1,
    container_name="Bezier",
    cpx=[0, 0.08131828904, 0.4414257109, 1],
    cpy=[0.3638902903, 0.3638902903, 0.348759532, 0])

# ---- group: Access gates (continued)
multiplication = Multiplication(A=central_proximity_distribution, B=vec2pt.Length)
amp = Amplitude(Vector=vec2pt.Vector, Amplitude=multiplication)
move = Move(Geometry=clean_2, Motion=amp)  # -> Geometry, Transform
incurve = PointInCurve(Point=flatten(move.Geometry), Curve=perimeter_4)  # -> Relationship, Point
cull_2 = CullPattern(List=flatten(move.Geometry), CullPattern=incurve.Relationship)
pt_5 = Point(cull_2)

# ---- group: Proximity to access gates (continued)
pt_6 = Point(pt_5)

# ---- group: Population density
area_district = Data(area.Area)
pop_district = Data(population)
perimeter_5 = Curve(perimeter)
districts_3 = Curve(districts)
division_3 = Division(A=pop_district, B=area_district)
srf_5 = Surface(districts_3)
density_district = Data(division_3)
bnd = Bounds(Numbers=density_district)
remap_2 = RemapNumbers(Value=density_district, Source=bnd, Target=Domain(0, 1))  # -> Mapped, Clipped
population_density_slider = Data(population_density)

# ----
graph = GraphMapper(
    remap_2.Mapped,
    x0=0,
    x1=1,
    y0=0,
    y1=1,
    container_name="Bezier",
    cpx=[0, 0.4976815581, 0.3449273705, 1],
    cpy=[0, 0.2800000906, 0.339130342, 0.6101449728])
gradient = Gradient(LowerLimit=0, UpperLimit=1, Parameter=graph, stops=[0: RGB(255, 192, 255), 1: RGB(128, 0, 128)])
population_2 = CustomPreview(Geometry=srf_5, Material=gradient)

# ---- group: Population density by district (continued)
relative_density = GraphMapper(
    remap_2.Mapped,
    x0=0,
    x1=1,
    y0=1,
    y1=2,
    container_name="Bezier",
    cpx=[0, 0.3137262464, 0.5046895146, 1],
    cpy=[0, 0.3555001616, 0.4646217227, 0.5601032972])

# ---- group: Population density (continued)
multiplication_2 = Multiplication(A=population_density_slider, B=relative_density)  # -> flatten(Result)
sdivide_3 = DivideSurface(Surface=perimeter_5, UCount=multiplication_2, VCount=multiplication_2)  # -> simplify(Points), Normals, Parameters
clean_3 = CleanTree(RemoveNulls=True, RemoveInvalid=True, RemoveEmpty=False, Tree=sdivide_3.Points)
path_mapper_2 = PathMapper(clean_3, source="{A;B}", target="{A}")
bang = ExplodeTree(Data=path_mapper_2)  # -> Branch0, Branch1, Branch2, Branch3, Branch4, Branch5, Branch6, Branch7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
incurve_2 = PointInCurve(
    Point=[bang.Branch0, bang.Branch1, bang.Branch2, bang.Branch3, bang.Branch4, bang.Branch5, bang.Branch6, bang.Branch7, bang.Branch8, bang.Branch9, bang.Branch10, bang.Branch11],
    Curve=graft(districts_3))  # -> Relationship, Point
bang_2 = ExplodeTree(Data=incurve_2.Relationship)  # -> Branch0, Branch1, Branch2, Branch3, Branch4, Branch5, Branch6, Branch7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
cull_3 = CullPattern(
    List=[bang.Branch0, bang.Branch1, bang.Branch2, bang.Branch3, bang.Branch4, bang.Branch5, bang.Branch6, bang.Branch7, bang.Branch8, bang.Branch9, bang.Branch10, bang.Branch11],
    CullPattern=[bang_2.Branch0, bang_2.Branch1, bang_2.Branch2, bang_2.Branch3, bang_2.Branch4, bang_2.Branch5, bang_2.Branch6, bang_2.Branch7, bang_2.Branch8, bang_2.Branch9, bang_2.Branch10, bang_2.Branch11])
pt_7 = Point(cull_3)

# ---- group: Population density by district (continued)
pt_8 = Point(pt_7)

# ---- group: Urban analysis result: point cloud
primary_road_pts = Point(pt)
access_gate_pts = Point(pt_5)
population_pts = Point(pt_7)
no_service_pts = Point(pt_3)

occupied_space = Curve(merge_2)
merge_4 = Merge(
    Data1=simplify(primary_road_pts),
    Data2=simplify(access_gate_pts),
    Data3=simplify(population_pts),
    Data4=simplify(no_service_pts))  # -> flatten(Result)

# ---- group: Stop further computing (continued)
filter_2 = StreamFilter(Gate=stream_block, Stream0=merge_4)

# ---- group: Urban analysis result: point cloud (continued)
incurves_2 = PointInCurves(Point=filter_2, Curves=occupied_space)  # -> Relationship, Index, Point
expression_2 = Expression(occupied=incurves_2.Relationship, Expression="if (occupied=0,True,False)")
cull_4 = CullPattern(List=filter_2, CullPattern=expression_2)
pt_9 = Point(cull_4)

# ---- group: Optimal location solver
number_slider = Slider(0.83, range=0..1)
number_slider_2 = Slider(0.64, range=0..1)
panel = Panel(small_large)
suitability_point_cloud = Point(pt_9)
radius_s = Number(hospital_radius_s_m_slider)
radius_l = Number(hospital_radius_l_m_slider)
camp_2 = Surface(reparameterize(camp))
filter_3 = StreamFilter(Gate=panel, Stream0=radius_s, Stream1=radius_l)
cluster = Cluster(X=number_slider, Y=number_slider_2)
evalsrf = EvaluateSurface(Surface=camp_2, Point=cluster)  # -> Point, Normal, UDirection, VDirection, Frame
crv_cp = CurveClosestPoint(Point=evalsrf.Point, Curve=primary_roads)  # -> Point, Parameter, Distance
sort_2 = SortList(Keys=crv_cp.Distance, ValuesA=crv_cp.Point)  # -> Keys, ValuesA
item_2 = ListItem(List=sort_2.ValuesA, Index=0, Wrap=True)
cir_4 = Circle(Plane=item_2, Radius=expr("1000*x", filter_3))
incurve_3 = PointInCurve(Point=suitability_point_cloud, Curve=cir_4)  # -> Relationship, Point
clean_4 = CleanTree(RemoveNulls=True, RemoveInvalid=True, RemoveEmpty=False, Tree=incurve_3.Relationship)
ma_2 = MassAddition(Input=clean_4)  # -> Result, PartialResults
panel_2 = Panel(ma_2.Result)

# ---- group: Optimal location solver / New location
location = Point(item_2)
range = Curve(cir_4)

# ---- group: New hospital service calculator
density_district_2 = Data(density_district)
districts_4 = Curve(districts)
location_2 = Curve(range)
rint = RegionIntersection(CurvesA=location_2, CurvesB=graft(districts_4))
crv = Curve(rint)
null = NullItem(Item=crv)  # -> flatten(NullFlags), InvalidFlags, Description
area_4 = Area(Geometry=crv)  # -> flatten(Area), Centroid
cull_5 = CullPattern(List=density_district_2, CullPattern=invert(null.NullFlags))
multiplication_3 = Multiplication(A=cull_5, B=area_4.Area)
ma_3 = MassAddition(Input=multiplication_3)  # -> Result, PartialResults
int = Integer(ma_3.Result)
people_in_hospital_area = Panel(int)

# ----
point_cloud = Point(pt_9)
data = Data(people_in_hospital_area)
population_in_range = Panel(data)
preview = CustomPreview(Geometry=[range, location], Material=ColourSwatch(SwatchColor=RGB(12, 148, 255)))

# ----
# Write to excel
python = GhPythonScript(population=people_in_hospital_area, capacity=merge)  # -> out, output
# ---------- python: Python ----------
import math 

output = math.ceil(capacity * population / 1000)
# ---------- end python ----------
density_dependent_program = Panel(python.output)

merge_5 = Merge(Data1=population_in_range, Data2=density_dependent_program)
excelwrite = ExcelWrite(
    WriteExcelData=Button(),
    WorkbookPath=path,
    WorksheetName="urban_analysis_output",
    ColumnHeadings="quantity",
    Data=merge_5,
    ClearSheet=False)

# ---- group: New hospital service calculator / Text display
concat = Concatenate(FragmentA="Number of refugees within new hospital range of service: ", FragmentB=people_in_hospital_area)
tag_2 = TextTag(Location=Point(4849285.965, 4065876.92, 0), Text=concat, Colour=ColourSwatch(SwatchColor=RGB(103, 0, 107)))

# ==== cluster Cluster
X = ClusterInput()
Y = ClusterInput()
pt = ConstructPoint(XCoordinate=X, YCoordinate=Y, ZCoordinate=0)
pt_2 = ClusterOutput(pt)
