# Grasshopper definition 1_Configuration_Cube_Model.gh (Grasshopper 1.0.7)
# plug-ins: LunchBox

# ---- group: Cube model
path = FilePath("C:\Users\jan_d\OneDrive\Documenten\Collegejaar '21-'22\AR3B011 EARTHY\Deliverables\1_Configuration\Data\1_Configuration_Output.xlsx")
excelread = ExcelReader(ReadExcelData=Toggle(True), WorkbookPath=path, WorksheetName="configuration_output")  # -> Exceptions, ExcelData
number_slider = Slider(3000, range=2000..3000)
cull_i = CullIndex(List=excelread.ExcelData, Indices=0, Wrap=True)
multiplication = Multiplication(A=cull_i, B=number_slider)
rectangle = Rectangle(Plane=PlaneXY(0, 0, 0), XSize=number_slider, YSize=number_slider, Radius=0)  # -> Rectangle, Length
bang = ExplodeTree(Data=multiplication)  # -> Branch0, Branch1, Branch2
pt = ConstructPoint(XCoordinate=bang.Branch0, YCoordinate=bang.Branch1, ZCoordinate=bang.Branch2)
boxrec = BoxRectangle(Rectangle=rectangle.Rectangle, Height=Slider(3900, range=3000..4000))
box_corners = BoxCorners(Box=boxrec)  # -> CornerA, CornerB, CornerC, CornerD, CornerE, CornerF, CornerG, CornerH
pt_2 = Point(box_corners.CornerA)
vec2pt = Vector2Pt(PointA=pt_2, PointB=pt, Unitize=False)  # -> Vector, Length
move = Move(Geometry=boxrec, Motion=vec2pt.Vector)  # -> Geometry, Transform
preview = CustomPreview(
    Geometry=move.Geometry,
    Material={diffuse=RGB(221, 160, 221), emission=RGB(66, 48, 66), shine=0.5, specular=RGB(255, 255, 255), transparency=0})

# ---- group: Ladybug Evaluation (under development)
path_2 = FilePath("C:\Users\jan_d\OneDrive\Documenten\Collegejaar '21-'22\AR3B011 EARTHY\Deliverables\1_Configuration\Data\Amman_Marka_AP_AM_JOR_1985.epw")
importepw = LBImportEPW(epw_file=path_2)  # -> location, dry_bulb_temperature, dew_point_temperature, relative_humidity, wind_speed, wind_direction, direct_normal_rad, diffuse_horizontal_rad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; plug-in component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
bbox = BoundingBox(Content=move.Geometry, Plane=PlaneXY(0, 0, 0), UnionBox=True)  # -> Box, Box_2
box = EvaluateBox(Box=bbox.Box, UParameter=0.5, VParameter=0.5, WParameter=0)  # -> Plane, Point, Include
pt_3 = Point(box.Point)
sunpath = LBSunPath(location=importepw.location, center_pt=pt_3, scale=Slider(0.5, range=0..1))  # -> report, vectors, altitudes, azimuths, hoys, sun_pts, analemma, daily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; plug-in component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
windrose = LBWindRose(data=importepw.wind_speed, wind_direction=importepw.wind_direction, center_pt=pt_3)  # -> report, mesh, compass, orient_line, freq_line, windrose_line, legend, title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; plug-in component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
