# Grasshopper definition 3x2 and 1x1 FINAL.gh (Grasshopper 1.0.7)
# plug-ins: Weaverbird, Kangaroo2 Components, karambaGH

# Values for this given project
panel = Panel("Values that don't change")

# ---- group: 1x1 shell / Mesh Sub-division
a01_22_10_2021 = Mesh(<mesh referenced from the Rhino model>)
# Making the mesh 3x2 with dynamic relaxation
# Open the right Rhino file to import the mesh, the curves and the meshes for the voxels
weaverbird_s_catmull_clark_subdivision = WeaverbirdsCatmullClarkSubdivision(MeshCurves=a01_22_10_2021, Level=Slider(3, range=0..10), SmoothNakedEdges=Slider(0, range=0..100))

a01_22_10_2021_2 = Mesh(<mesh referenced from the Rhino model>)
# Making the mesh 1x1 with dynamic relaxation
# Open the right Rhino file to import the mesh, the curves and the meshes for the voxels
weaverbird_s_catmull_clark_subdivision_2 = WeaverbirdsCatmullClarkSubdivision(MeshCurves=a01_22_10_2021_2, Level=Slider(3, range=0..10), SmoothNakedEdges=Slider(0, range=0..100))

# ---- group: Voxels
# Change voxels depending on module
voxels_for_1x1 = Brep([<brep referenced from the Rhino model> x42])
voxels_for_3x2 = Brep([<brep referenced from the Rhino model> x42])
geometry = Geometry(graft(voxels_for_1x1))
series = Series(Start=0, Step="0.3", Count=Slider(23, range=0..50))
series_2 = Series(Start=0, Step="0.3", Count=Slider(34, range=0..50))
unit_y = UnitY(Factor=series)
unit_x = UnitX(Factor=series_2)

# ----
# Voxalised meshes
cull_pattern = CullPattern(List=geometry, CullPattern=Toggle(False))

# ---- group: 1x1 shell / Edge length & load parameters
# Values that change for optimalisation
number_slider = Slider(0.5, range=0..10)

# ---- group: 1x1 shell
# Carethy + _______earthy 4.0
# 
# 1*1 Module
# 2.4m*2.4m - Spatial Unit Size
# 0.3m - Column Size
# 4 - Number of Supports
# Change these to define dynamic relaxation
mesh = Mesh(weaverbird_s_catmull_clark_subdivision)

nakedvertices = NakedVertices(Mesh=mesh)  # -> ClothedIndex, NakedIndex, ClothedPts, NakedPts
point = Point(nakedvertices.NakedPts)

# ---- group: 1x1 shell / Edge length & load parameters
edgelengths = EdgeLengths(Mesh=mesh, LengthFactor=Slider(0.5, range=0..10), Strength=Slider(7.5, range=0..10))
vertexloads = VertexLoads(Mesh=mesh, Strength=Slider(0.05, range=0..10))

# ---- group: 1x1 shell / Anchor Points Collection
deconstruct = Deconstruct(Point=point)  # -> XComponent, YComponent, ZComponent
negative = Negative(Value=Slider(0.9, range=0..10))
larger_than = LargerThan(FirstNumber=negative, SecondNumber=deconstruct.ZComponent)  # -> LargerThan, OrEqualTo
cull = CullPattern(List=point, CullPattern=larger_than.OrEqualTo)
point_2 = Point(cull)
anchor = Anchor(Point=point_2, Strength=10000)

# ---- group: 1x1 shell / X,Y Anchor
curve = Curve([<curve referenced from the Rhino model> x18])
curve_2 = Curve([<curve referenced from the Rhino model> x12])
incurves = PointInCurves(Point=point, Curves=curve_2)  # -> Relationship, Index, Point
incurves_2 = PointInCurves(Point=point, Curves=curve)  # -> Relationship, Index, Point
cull_2 = CullPattern(List=point, CullPattern=incurves.Relationship)
cull_3 = CullPattern(List=point, CullPattern=incurves_2.Relationship)
point_3 = Point(cull_2)
point_4 = Point(cull_3)
anchorxyz = AnchorXYZ(Point=point_3, X=Toggle(True), Y=False, Z=False, Strength=1000)
anchorxyz_2 = AnchorXYZ(Point=point_4, X=False, Y=Toggle(True), Z=False, Strength=1000)

# ---- group: 1x1 shell / Dynamic Relaxation
show = Show(G=mesh)
solver = Solver(
    GoalObjects=[anchor, show, edgelengths, vertexloads, anchorxyz, anchorxyz_2],
    Reset=Button(),
    Threshold=1e-15,
    Tolerance=0.0001,
    On=Toggle(False))  # -> I, V, O

# ---- group: 1x1 shell (continued)
tree_branch = TreeBranch(Tree=solver.O, Path="0,0", MaintainPaths=True)

# Carethy + _______earthy 4.0
# 
# 1*1 Module
# 2.4m*2.4m - Spatial Unit Size
# 0.3m - Column Size
# 4 - Number of Supports
# Change these to define dynamic relaxation
mesh_2 = Mesh(weaverbird_s_catmull_clark_subdivision_2)

nakedvertices_2 = NakedVertices(Mesh=mesh_2)  # -> ClothedIndex, NakedIndex, ClothedPts, NakedPts
point_5 = Point(nakedvertices_2.NakedPts)

# ---- group: 1x1 shell / Edge length & load parameters (continued)
edgelengths_2 = EdgeLengths(Mesh=mesh_2, LengthFactor=number_slider, Strength=Slider(5, range=0..10))
vertexloads_2 = VertexLoads(Mesh=mesh_2, Strength=Slider(0.05, range=0..10))

# ---- group: 1x1 shell / Anchor Points Collection
deconstruct_2 = Deconstruct(Point=point_5)  # -> XComponent, YComponent, ZComponent
negative_2 = Negative(Value=Slider(0.9, range=0..10))
larger_than_2 = LargerThan(FirstNumber=negative_2, SecondNumber=deconstruct_2.ZComponent)  # -> LargerThan, OrEqualTo
cull_4 = CullPattern(List=point_5, CullPattern=larger_than_2.OrEqualTo)
point_6 = Point(cull_4)
anchor_2 = Anchor(Point=point_6, Strength=10000)

# ---- group: 1x1 shell / X,Y Anchor
curve_3 = Curve([<curve referenced from the Rhino model> x6])
curve_4 = Curve([<curve referenced from the Rhino model> x6])
incurves_3 = PointInCurves(Point=point_5, Curves=curve_4)  # -> Relationship, Index, Point
incurves_4 = PointInCurves(Point=point_5, Curves=curve_3)  # -> Relationship, Index, Point
cull_5 = CullPattern(List=point_5, CullPattern=incurves_3.Relationship)
cull_6 = CullPattern(List=point_5, CullPattern=incurves_4.Relationship)
point_7 = Point(cull_5)
point_8 = Point(cull_6)
anchorxyz_3 = AnchorXYZ(Point=point_7, X=Toggle(True), Y=False, Z=False, Strength=1000)
anchorxyz_4 = AnchorXYZ(Point=point_8, X=False, Y=Toggle(True), Z=False, Strength=1000)

# ---- group: 1x1 shell / Dynamic Relaxation
show_2 = Show(G=mesh_2)
solver_2 = Solver(
    GoalObjects=[anchor_2, show_2, edgelengths_2, vertexloads_2, anchorxyz_3, anchorxyz_4],
    Reset=Button(),
    Threshold=1e-15,
    Tolerance=0.0001,
    On=Toggle(False))  # -> I, V, O

# ---- group: 1x1 shell (continued)
tree_branch_2 = TreeBranch(Tree=solver_2.O, Path="0,0", MaintainPaths=True)

# ---- group: Voxels (continued)
move = Move(Geometry=cull_pattern, Motion=unit_x)  # -> graft(Geometry), Transform
move_2 = Move(Geometry=move.Geometry, Motion=unit_y)  # -> flatten(Geometry), Transform

# ---- group: Sand infill load
xy = XYPlane(Origin=Point(30.12712602, 1.199779715, 0))
Z = UnitZ(Factor=1)
Z_2 = UnitZ(Factor=1)

# ---- group: Live load first floor
live_load = Panel("-2")
sf = Panel("0.075")
multiplication = Multiplication(A=live_load, B=sf)
unit_z = UnitZ(Factor=multiplication)

# ---- group: Analyse shell
# Open the right Rhino file to import the mesh, the curves and the meshes for the voxels
boolean_toggle = BooleanToggle(False)
point_9 = Point(point_6)
cull_pattern_2 = CullPattern(List=tree_branch_2, CullPattern=boolean_toggle)
mesh_3 = Mesh(cull_pattern_2)
material_density_kn_m3 = Panel("15")
shear_modulus = Panel("4")
id = Panel("shell01")
lcase = Panel("0")
cm = Panel("30")
youngs_modulus = Panel("11")
Z_3 = UnitZ(Factor="-1.35")
loads = LoadsKaramba3D(Vector=Z_3, LCase=lcase, mode="Gravity")
material_properties_karamba3d = MaterialPropertiesKaramba3D(
    FamilyOfMaterial="Earth blocks",
    Name="Adobe",
    ElementIdentifier=id,
    YoungsModulus_kN_cm2=youngs_modulus,
    InPlaneShearModulus_kN_cm2=shear_modulus,
    TransverseShearModulus_kN_cm2=shear_modulus,
    SpecificWeight_kN_m3=material_density_kn_m3,
    CoefficientOfThermalExpansion_1_C=1e-05,
    YieldStrength_kN_cm2=23.5,
    mode="Isotrop")
cross_section = CrossSectionKaramba3D(
    FamilyNameOfCrossSection="DefaultCroSec",
    ElementIdentifier=id,
    Material=material_properties_karamba3d,
    Height_cm=cm,
    mode="Shell - Const")
# Analyse module with loads input
meshtoshell = MeshToShellKaramba3D(Mesh=mesh_3, Identifier=id, CrossSection=cross_section, LimitDistance_m=0.005)  # -> Element, Points, Info
pt = Point(flatten(point_9))
supp = SupportKaramba3D(PosInd=pt, menu=[buttons(on, on, on, off, off, off)])

# ---- group: Voxels (continued)
# Change mesh B depending on module
mesh_mesh = MeshMesh(MeshA=move_2.Geometry, MeshB=graft(cull_pattern_2), UseMeshMeshFast=True)
list_length = ListLength(List=mesh_mesh)  # -> flatten(Length)
expression = Expression(x=list_length, Expression="If(x=0, true, false)")
dispatch = Dispatch(List=move_2.Geometry, DispatchPattern=expression)  # -> ListA, ListB
mesh_4 = Mesh(dispatch.ListB)

# ---- group: Make wall infill loads
demesh = DeconstructMesh(Mesh=mesh_3)  # -> Vertices, Faces, Colours, Normals
deconstruct_3 = Deconstruct(Point=demesh.Vertices)  # -> XComponent, YComponent, ZComponent
sort_list = SortList(Keys=deconstruct_3.XComponent, ValuesValuesA=deconstruct_3.YComponent)  # -> Keys, ValuesValuesA
sort_list_2 = SortList(Keys=deconstruct_3.XComponent, ValuesValuesA=deconstruct_3.ZComponent)  # -> Keys, ValuesValuesA
list_item = ListItem(List=sort_list.Keys, Index=" 0", Wrap=False)
list_item_2 = ListItem(List=sort_list.ValuesValuesA, Index=" 0", Wrap=False)
list_item_3 = ListItem(List=sort_list_2.ValuesValuesA, Index=" 0", Wrap=False)
construct_point = ConstructPoint(XCoordinate=list_item, YCoordinate=list_item_2, ZCoordinate=list_item_3)
yz_plane = YZPlane(Origin=construct_point)
cp = PlaneClosestPoint(Point=demesh.Vertices, Plane=yz_plane)  # -> Point, UVPoint, Distance
sort_list_3 = SortList(Keys=cp.Distance, ValuesValuesA=demesh.Vertices)  # -> Keys, ValuesValuesA
pick_value_between_32_and_33 = Panel(sort_list_3.Keys)
# Manually pick the center point of the mesh from Rhino
center_point_of_mesh = Point(Point(1.5, 0.1227464514, 0))
smaller_than = SmallerThan(FirstNumber=sort_list_3.Keys, SecondNumber="0.0002")  # -> SmallerThan, OrEqualTo
dispatch_2 = Dispatch(List=sort_list_3.ValuesValuesA, DispatchPattern=smaller_than.SmallerThan)  # -> ListA, ListB
point_10 = Point(dispatch_2.ListA)
rotate = Rotate(Geometry=point_10, Angle=1.570796327, Plane=center_point_of_mesh)  # -> Geometry, Transform
rotate_2 = Rotate(Geometry=point_10, Angle=3.141592654, Plane=center_point_of_mesh)  # -> Geometry, Transform
rotate_3 = Rotate(Geometry=point_10, Angle=-1.570796327, Plane=center_point_of_mesh)  # -> Geometry, Transform
point_11 = Point(rotate.Geometry)
point_12 = Point(rotate_2.Geometry)
point_13 = Point(rotate_3.Geometry)
deconstruct_4 = Deconstruct(Point=point_11)  # -> XComponent, YComponent, ZComponent
deconstruct_5 = Deconstruct(Point=point_12)  # -> XComponent, YComponent, ZComponent
deconstruct_6 = Deconstruct(Point=point_13)  # -> XComponent, YComponent, ZComponent
deconstruct_7 = Deconstruct(Point=point_10)  # -> XComponent, YComponent, ZComponent
sort_list_4 = SortList(Keys=deconstruct_4.XComponent, ValuesValuesA=point_11)  # -> Keys, ValuesValuesA
sort_list_5 = SortList(Keys=deconstruct_4.ZComponent, ValuesValuesA=point_11)  # -> Keys, ValuesValuesA
sort_list_6 = SortList(Keys=deconstruct_5.XComponent, ValuesValuesA=point_12)  # -> Keys, ValuesValuesA
sort_list_7 = SortList(Keys=deconstruct_5.ZComponent, ValuesValuesA=point_12)  # -> Keys, ValuesValuesA
sort_list_8 = SortList(Keys=deconstruct_6.XComponent, ValuesValuesA=point_13)  # -> Keys, ValuesValuesA
sort_list_9 = SortList(Keys=deconstruct_6.ZComponent, ValuesValuesA=point_13)  # -> Keys, ValuesValuesA
sort_list_10 = SortList(Keys=deconstruct_7.XComponent, ValuesValuesA=point_10)  # -> Keys, ValuesValuesA
sort_list_11 = SortList(Keys=deconstruct_7.ZComponent, ValuesValuesA=point_10)  # -> Keys, ValuesValuesA
list_length_2 = ListLength(List=sort_list_4.Keys)
list_length_3 = ListLength(List=sort_list_6.Keys)
list_length_4 = ListLength(List=sort_list_8.Keys)
list_length_5 = ListLength(List=sort_list_10.Keys)
list_item_4 = ListItem(List=sort_list_5.ValuesValuesA, Index="0", Wrap=False)
list_item_5 = ListItem(List=sort_list_7.ValuesValuesA, Index="0", Wrap=False)
list_item_6 = ListItem(List=sort_list_9.ValuesValuesA, Index="0", Wrap=False)
list_item_7 = ListItem(List=sort_list_11.ValuesValuesA, Index="0", Wrap=False)
subtraction = Subtraction(A=list_length_2, B="1")
subtraction_2 = Subtraction(A=list_length_3, B="1")
subtraction_3 = Subtraction(A=list_length_4, B="1")
subtraction_4 = Subtraction(A=list_length_5, B="1")
xy_2 = XYPlane(Origin=list_item_4)
xy_3 = XYPlane(Origin=list_item_5)
xy_4 = XYPlane(Origin=list_item_6)
xy_5 = XYPlane(Origin=list_item_7)
cp_2 = PlaneClosestPoint(Point=point_11, Plane=xy_2)  # -> Point, UVPoint, Distance
cp_3 = PlaneClosestPoint(Point=point_12, Plane=xy_3)  # -> Point, UVPoint, Distance
cp_4 = PlaneClosestPoint(Point=point_13, Plane=xy_4)  # -> Point, UVPoint, Distance
cp_5 = PlaneClosestPoint(Point=point_10, Plane=xy_5)  # -> Point, UVPoint, Distance
list_item_8 = ListItem(List=sort_list_4.ValuesValuesA, Index=subtraction, Wrap=False)
list_item_9 = ListItem(List=sort_list_6.ValuesValuesA, Index=subtraction_2, Wrap=False)
list_item_10 = ListItem(List=sort_list_8.ValuesValuesA, Index=subtraction_3, Wrap=False)
list_item_11 = ListItem(List=sort_list_10.ValuesValuesA, Index=subtraction_4, Wrap=False)
list_item_12 = ListItem(List=sort_list_4.ValuesValuesA, Index="0", Wrap=False)
list_item_13 = ListItem(List=sort_list_6.ValuesValuesA, Index="0", Wrap=False)
list_item_14 = ListItem(List=sort_list_8.ValuesValuesA, Index="0", Wrap=False)
list_item_15 = ListItem(List=sort_list_10.ValuesValuesA, Index="0", Wrap=False)
line = Line(StartPoint=point_11, EndPoint=cp_2.Point)
line_2 = Line(StartPoint=point_12, EndPoint=cp_3.Point)
line_3 = Line(StartPoint=point_13, EndPoint=cp_4.Point)
line_4 = Line(StartPoint=point_10, EndPoint=cp_5.Point)
distance = Distance(PointA=list_item_8, PointB=list_item_12)
distance_2 = Distance(PointA=list_item_9, PointB=list_item_13)
distance_3 = Distance(PointA=list_item_10, PointB=list_item_14)
distance_4 = Distance(PointA=list_item_11, PointB=list_item_15)
list_length_6 = ListLength(List=cp_2.Point)
list_length_7 = ListLength(List=cp_3.Point)
list_length_8 = ListLength(List=cp_4.Point)
list_length_9 = ListLength(List=cp_5.Point)
thickness_wall = Panel(" 0.3")
thickness_wall_2 = Panel(" 0.3")
thickness_wall_3 = Panel(" 0.3")
thickness_wall_4 = Panel(" 0.3")
division = Division(A=distance, B=list_length_6)
division_2 = Division(A=distance_2, B=list_length_7)
division_3 = Division(A=distance_3, B=list_length_8)
division_4 = Division(A=distance_4, B=list_length_9)
multiplication_2 = Multiplication(A=division, B=thickness_wall)
multiplication_3 = Multiplication(A=division_2, B=thickness_wall_2)
multiplication_4 = Multiplication(A=division_3, B=thickness_wall_3)
multiplication_5 = Multiplication(A=division_4, B=thickness_wall_4)
density = Panel(material_density_kn_m3)
density_2 = Panel(material_density_kn_m3)
density_3 = Panel(material_density_kn_m3)
density_4 = Panel(material_density_kn_m3)
multiplication_6 = Multiplication(A=cp_2.Distance, B=multiplication_2)
multiplication_7 = Multiplication(A=cp_3.Distance, B=multiplication_3)
multiplication_8 = Multiplication(A=cp_4.Distance, B=multiplication_4)
multiplication_9 = Multiplication(A=cp_5.Distance, B=multiplication_5)
a_x_b = Multiplication(A=density_3, B="-1")
a_x_b_2 = Multiplication(A=density_4, B="-1")
a_x_b_3 = Multiplication(A=density_2, B="-1")
a_x_b_4 = Multiplication(A=density, B="-1")
multiplication_10 = Multiplication(A=multiplication_6, B=a_x_b)
multiplication_11 = Multiplication(A=multiplication_7, B=a_x_b_2)
multiplication_12 = Multiplication(A=multiplication_8, B=a_x_b_3)
multiplication_13 = Multiplication(A=multiplication_9, B=a_x_b_4)
Z_4 = UnitZ(Factor=1)
Z_5 = UnitZ(Factor=1)
Z_6 = UnitZ(Factor=1)
Z_7 = UnitZ(Factor=1)
amp = Amplitude(Vector=Z_4, Amplitude=multiplication_10)
amp_2 = Amplitude(Vector=Z_5, Amplitude=multiplication_11)
amp_3 = Amplitude(Vector=Z_6, Amplitude=multiplication_12)
amp_4 = Amplitude(Vector=Z_7, Amplitude=multiplication_13)
loads_karamba3d = LoadsKaramba3D(ForceVector=amp_4, Local=False, PosInd=point_10, LCase=lcase, mode="Point")
loads_karamba3d_2 = LoadsKaramba3D(ForceVector=amp, Local=False, PosInd=rotate.Geometry, LCase=lcase, mode="Point")
loads_karamba3d_3 = LoadsKaramba3D(ForceVector=amp_2, Local=False, PosInd=rotate_2.Geometry, LCase=lcase, mode="Point")
loads_karamba3d_4 = LoadsKaramba3D(ForceVector=amp_3, Local=False, PosInd=rotate_3.Geometry, LCase=lcase, mode="Point")

# ---- group: Sand infill load (continued)
demesh_2 = DeconstructMesh(Mesh=mesh_3)  # -> Vertices, Faces, Colours, Normals
cp_6 = PlaneClosestPoint(Point=demesh_2.Vertices, Plane=xy)  # -> Point, UVPoint, Distance
sort = SortList(Keys=cp_6.Distance, ValuesA=demesh_2.Vertices)  # -> Keys, ValuesA
list_length_10 = ListLength(List=sort.ValuesA)
subtraction_5 = Subtraction(A=list_length_10, B="1")
item = ListItem(List=sort.ValuesA, Index=subtraction_5, Wrap=True)
pdecon = Deconstruct(Point=item)  # -> XComponent, YComponent, ZComponent
pt_2 = ConstructPoint(XCoordinate=pdecon.XComponent, YCoordinate=pdecon.YComponent, ZCoordinate="0")
dist = Distance(PointA=pt_2, PointB=item)
mesh_5 = Mesh(mesh_3)
amp_5 = Amplitude(Vector=Z, Amplitude=dist)
move_3 = Move(Geometry=cp_6.Point, Motion=amp_5)  # -> Geometry, Transform
area = Area(Geometry=mesh_5)  # -> Area, Centroid
line_5 = Line(StartPoint=move_3.Geometry, EndPoint=demesh_2.Vertices)
a_x_b_5 = Multiplication(A=material_density_kn_m3, B="-1.35")
dist_2 = Distance(PointA=demesh_2.Vertices, PointB=move_3.Geometry)
lng = ListLength(List=move_3.Geometry)
division_5 = Division(A=area.Area, B=lng)
multiplication_14 = Multiplication(A=division_5, B=a_x_b_5)
multiplication_15 = Multiplication(A=dist_2, B=multiplication_14)
amp_6 = Amplitude(Vector=Z_2, Amplitude=multiplication_15)
loads_karamba3d_5 = LoadsKaramba3D(ForceVector=amp_6, Local=False, PosInd=demesh_2.Vertices, LCase=lcase, mode="Point")

# ---- group: Define wind load
deconstruct_mesh = DeconstructMesh(Mesh=mesh_3)  # -> Vertices, Faces, Colours, Normals
cull_duplicates = CullDuplicates(Points=deconstruct_mesh.Vertices, Tolerance=0.1, CullMode=3)  # -> flatten(Points), Indices, Valence
deconstruct_8 = Deconstruct(Point=cull_duplicates.Points)  # -> XComponent, YComponent, ZComponent
smaller_than_2 = SmallerThan(FirstNumber=deconstruct_8.YComponent, SecondNumber=Slider(0.8, range=0..100))  # -> SmallerThan, OrEqualTo
check_range_for_number_slider = Panel(deconstruct_8.YComponent)
dispatch_3 = Dispatch(List=cull_duplicates.Points, DispatchPattern=smaller_than_2.SmallerThan)  # -> ListA, ListB
geometry_2 = Geometry(dispatch_3.ListA)
wind_load = Panel("-0.2")
sf_2 = Panel("1.5")
multiplication_16 = Multiplication(A=wind_load, B=sf_2)
unit_y_2 = UnitY(Factor=multiplication_16)
loads_karamba3d_6 = LoadsKaramba3D(
    Vector=unit_y_2,
    Mesh=mesh_3,
    ElementIdentifiers=id,
    AddPos=geometry_2,
    LCase=lcase,
    mode="MeshLoad -Const.",
    menu=[buttons(off, on, off), buttons(on, on)])

# ---- group: Live load first floor (continued)
loads_karamba3d_7 = LoadsKaramba3D(
    Vector=unit_z,
    Mesh=mesh_3,
    ElementIdentifiers=id,
    LCase=lcase,
    mode="MeshLoad -Const.",
    menu=[buttons(off, on, off), buttons(on, on)])

# ---- group: Live load roof
live_load_2 = Panel("-2")
sf_3 = Panel("0.75")
multiplication_17 = Multiplication(A=live_load_2, B=sf_3)
unit_z_2 = UnitZ(Factor=multiplication_17)
loads_karamba3d_8 = LoadsKaramba3D(
    Vector=unit_z_2,
    Mesh=mesh_3,
    ElementIdentifiers=id,
    LCase=lcase,
    mode="MeshLoad -Const.",
    menu=[buttons(off, on, off), buttons(on, on)])

# ---- group: Snow load
snow_load = Panel("-0.02")
sf_4 = Panel("0.075")
multiplication_18 = Multiplication(A=snow_load, B=sf_4)
unit_z_3 = UnitZ(Factor=multiplication_18)
loads_karamba3d_9 = LoadsKaramba3D(
    Vector=unit_z_3,
    Mesh=mesh_3,
    ElementIdentifiers=id,
    LCase=lcase,
    mode="MeshLoad -Const.",
    menu=[buttons(off, on, off), buttons(on, on)])

# ---- group: Analyse shell (continued)
# For the 3x2 mesh, unplug the sand infill, the first floor live load and the wall loads.
assemble = AssembleModelKaramba3D(
    Elem=meshtoshell.Element,
    Support=supp,
    Load=flatten([loads, loads_karamba3d_6, loads_karamba3d_7, loads_karamba3d_9, loads_karamba3d_8, loads_karamba3d_5, loads_karamba3d, loads_karamba3d_2, loads_karamba3d_3, loads_karamba3d_4]),
    LimitDistance_m=0.005)  # -> Model, Info, Mass_kg, CenterOfGravity
analyze = AnalyzeKaramba3D(Model=assemble.Model)  # -> CalculatedModel, MaximumDisplacement_cm, ResultingForceOfGravity_kN, ElasticEnergy_kNm

# ----
# Check stresses 1&2, deflection and input manual excel
# Maximal compression stress can be -0.15 = 15e-2 kN/cm2
# 
# Maximal tensile stress can be +0.015 = 1.5e-2 kN/cm2
boolean_toggle_2 = BooleanToggle(False)
# Connect pink for deflection output
swatch = ColourSwatch(SwatchColor=RGB(249, 142, 255))
swatch_2 = ColourSwatch(SwatchColor=RGB(42, 0, 255))
swatch_3 = ColourSwatch(SwatchColor=RGB(255, 0, 0))
cull_pattern_3 = CullPattern(List=analyze.CalculatedModel, CullPattern=boolean_toggle_2)
merge = Merge(
    Data1=swatch_3,
    Data2=swatch_3,
    Data3=swatch_3,
    Data4=ColourSwatch(SwatchColor=RGB(255, 255, 255)),
    Data5=swatch_2,
    Data6=swatch_2,
    Data7=swatch_2)
modelview = ModelViewKaramba3D(Model=cull_pattern_3, ResultFactors=1, ResultCase=-1, Colors=merge)  # -> Model, DeformedMesh, DeformedAxes, DeformedModel
shellview = ShellViewKaramba3D(Model=modelview.Model, IndexOfLayer=0)  # -> Model, MeshesOfRenderedShells, LegendColors, flatten(LegendTags)
legend = Legend(
    Colour=shellview.LegendColors,
    Tags=shellview.LegendTags,
    Rectangle={Plane=PlaneXY(-12.49104186, 20.02327199, 0), Size=Domain2(u=-0.3945620632..0.3945620632, v=-1.197777692..1.197777692)},
    LegendType=1)
shellview_2 = ShellViewKaramba3D(Model=modelview.Model, IndexOfLayer=0)  # -> Model, MeshesOfRenderedShells, LegendColors, LegendTags
legend_2 = Legend(
    Colour=shellview_2.LegendColors,
    Tags=shellview_2.LegendTags,
    Rectangle={Plane=PlaneXY(-11.62297699, 19.99576805, 0), Size=Domain2(u=-0.3579612421..0.3579612421, v=-1.209908998..1.209908998)},
    LegendType=1)

# ---- group: For excel hand calculations
unit_x_2 = UnitX(Factor="0.3")
multiplication_19 = Multiplication(A=division_5, B=dist_2)
move_4 = Move(Geometry=yz_plane, Motion=unit_x_2)  # -> Geometry, Transform
mass_addition = MassAddition(Input=multiplication_19)  # -> Result, PartialResults
mesh_plane = MeshPlane(Mesh=mesh_5, Plane=move_4.Geometry)
join_curves = JoinCurves(Curves=mesh_plane, Preserve=False)
end_points = EndPoints(Curve=join_curves)  # -> Start, End
line_6 = Line(StartPoint=end_points.Start, EndPoint=end_points.End)
edge_surface = EdgeSurface(CurveA=join_curves, CurveB=line_6)
area_2 = Area(Geometry=edge_surface)  # -> Area, Centroid
volume_of_sand_infill = Panel(mass_addition.Result)
area_of_wall = Panel(area_2.Area)
shell_area_roof_area = Panel(area.Area)
