# Grasshopper definition Wall types.gh (Grasshopper 1.0.7)

# Values for this given project
panel = Panel("Values that don't change")

# ---- group: Making voxels for walls
brep = Brep([<brep referenced from the Rhino model> x16])
geometry = Geometry(graft(brep))
series = Series(Start=0, Step="0.3", Count=Slider(10, range=0..50))
# Values that change for optimalisation
unit_x = UnitX(Factor=series)
move = Move(Geometry=geometry, Motion=unit_x)  # -> flatten(Geometry), Transform

# ----
surface = Surface(<surface referenced from the Rhino model>)
surface_2 = Surface(<surface referenced from the Rhino model>)
surface_3 = Surface(<surface referenced from the Rhino model>)
# Select wall type to voxelised. The W-01 should stay connected to the top mesh to mesh.
surface_4 = Surface(<surface referenced from the Rhino model>)
geometry_2 = Geometry([<brep referenced from the Rhino model> x184])

# ---- group: Make voxels for any wall type
# Select voxels that might intersect with the made voxels
mesh_mesh = MeshMesh(MeshA=move.Geometry, MeshB=surface_3, UseMeshMeshFast=True)
list_length = ListLength(List=mesh_mesh)  # -> flatten(Length)
expression = Expression(x=list_length, Expression="If(x=0, true, false)")
dispatch = Dispatch(List=move.Geometry, DispatchPattern=expression)  # -> ListA, ListB
mesh = Mesh(dispatch.ListB)
volume = Volume(Geometry=geometry_2)  # -> Volume, Centroid
volume_2 = Volume(Geometry=mesh)  # -> Volume, Centroid
closest_point = ClosestPoint(Point=volume_2.Centroid, Cloud=volume.Centroid)  # -> ClosestPoint, CPIndex, Distance
expression_2 = Expression(x=closest_point.Distance, Expression="If(x<0.16, true, false)")
dispatch_2 = Dispatch(List=mesh, DispatchPattern=expression_2)  # -> ListA, ListB
mesh_2 = Mesh(dispatch_2.ListB)

# ---- group: Make voxels for small opening
# Select voxels that might intersect with the made voxels
panel_2 = Panel("6.6")
unit_x_2 = UnitX(Factor=panel_2)
move_2 = Move(Geometry=mesh_2, Motion=unit_x_2)  # -> Geometry, Transform
geometry_3 = Geometry([<brep referenced from the Rhino model> x276])
volume_3 = Volume(Geometry=move_2.Geometry)  # -> Volume, Centroid
volume_4 = Volume(Geometry=geometry_3)  # -> Volume, Centroid
closest_point_2 = ClosestPoint(Point=volume_3.Centroid, Cloud=volume_4.Centroid)  # -> ClosestPoint, CPIndex, Distance
expression_3 = Expression(x=closest_point_2.Distance, Expression="If(x<0.16, true, false)")
dispatch_3 = Dispatch(List=move_2.Geometry, DispatchPattern=expression_3)  # -> ListA, ListB
mesh_3 = Mesh(dispatch_3.ListB)

# ---- group: Final voxels
unit_x_3 = UnitX(Factor="-6.6")
move_3 = Move(Geometry=mesh_3, Motion=unit_x_3)  # -> Geometry, Transform
volume_5 = Volume(Geometry=move_3.Geometry)  # -> Volume, Centroid
volume_6 = Volume(Geometry=mesh_2)  # -> Volume, Centroid
closest_point_3 = ClosestPoint(Point=volume_6.Centroid, Cloud=volume_5.Centroid)  # -> ClosestPoint, CPIndex, Distance
expression_4 = Expression(x=closest_point_3.Distance, Expression="If(x<0.16, true, false)")
dispatch_4 = Dispatch(List=mesh_2, DispatchPattern=expression_4)  # -> ListA, ListB
# The mesh from list A is the smallest wall infill. The voxels from list B can be added for the bigger infill.
mesh_4 = Mesh(dispatch_4.ListA)
mesh_5 = Mesh(dispatch_4.ListB)
