# Grasshopper definition Truss system.gh (Grasshopper 1.0.7)
# plug-ins: karambaGH

# Values for this given project
# Values that change for optimalisation
panel = Panel("Values that don't change")

# ---- group: Original mesh and mesh with added voxels
added_voxels = Mesh([<mesh referenced from the Rhino model> x548])
original = Mesh([<mesh referenced from the Rhino model> x536])

# ---- group: Sort voxels on height
mesh = Mesh(original)
volume = Volume(Geometry=mesh)  # -> Volume, Centroid
deconstruct = Deconstruct(Point=volume.Centroid)  # -> XComponent, YComponent, ZComponent
list_length = ListLength(List=volume.Centroid)
sort_list = SortList(Keys=deconstruct.ZComponent, ValuesValuesA=mesh)  # -> Keys, ValuesValuesA
delete_consecutive = DeleteConsecutive(Set=sort_list.Keys, Wrap=False)  # -> Set, Count
item_index = ItemIndex(List=sort_list.Keys, Item=delete_consecutive.Set)
cull_index = CullIndex(List=item_index, Indices="0", Wrap=False)
insert_items = InsertItems(List=cull_index, Item=list_length, Indices="19", Wrap=False)
subtraction = Subtraction(A=insert_items, B="1")
construct_domain = ConstructDomain(DomainStart=item_index, DomainEnd=subtraction)
sub_list = SubList(List=sort_list.ValuesValuesA, Domain=construct_domain, Wrap=False)  # -> simplify(List), Index
panel_2 = Panel(sub_list.List)
explode_tree = ExplodeTree(Data=sub_list.List)  # -> Branch0, Branch1, Branch2, Branch3, Branch4, Branch5, Branch6, Branch7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

# ---- group: Make boxes per height
deconstruct_mesh = DeconstructMesh(Mesh=[explode_tree.Branch3, explode_tree.Branch4])  # -> Vertices, Faces, Colours, Normals
deconstruct_mesh_2 = DeconstructMesh(Mesh=explode_tree.Branch2)  # -> Vertices, Faces, Colours, Normals
deconstruct_mesh_3 = DeconstructMesh(Mesh=explode_tree.Branch1)  # -> Vertices, Faces, Colours, Normals
deconstruct_mesh_4 = DeconstructMesh(Mesh=explode_tree.Branch0)  # -> Vertices, Faces, Colours, Normals
list_item = ListItem(List=deconstruct_mesh.Faces, Index=Slider(5, range=0..5), Wrap=True)
list_item_2 = ListItem(List=deconstruct_mesh_2.Faces, Index=Slider(5, range=0..5), Wrap=True)
list_item_3 = ListItem(List=deconstruct_mesh_3.Faces, Index=Slider(5, range=0..5), Wrap=True)
list_item_4 = ListItem(List=deconstruct_mesh_4.Faces, Index=Slider(5, range=0..5), Wrap=True)
deconstruct_face = DeconstructFace(Face=list_item)  # -> CornerA, CornerB, CornerC, CornerD
deconstruct_face_2 = DeconstructFace(Face=list_item_2)  # -> CornerA, CornerB, CornerC, CornerD
deconstruct_face_3 = DeconstructFace(Face=list_item_3)  # -> CornerA, CornerB, CornerC, CornerD
deconstruct_face_4 = DeconstructFace(Face=list_item_4)  # -> CornerA, CornerB, CornerC, CornerD
list_item_5 = ListItem(List=deconstruct_mesh.Vertices, Index=deconstruct_face.CornerA, Wrap=True)
list_item_6 = ListItem(List=deconstruct_mesh.Vertices, Index=deconstruct_face.CornerB, Wrap=True)
list_item_7 = ListItem(List=deconstruct_mesh.Vertices, Index=deconstruct_face.CornerC, Wrap=True)
list_item_8 = ListItem(List=deconstruct_mesh_2.Vertices, Index=deconstruct_face_2.CornerA, Wrap=True)
list_item_9 = ListItem(List=deconstruct_mesh.Vertices, Index=deconstruct_face.CornerD, Wrap=True)
list_item_10 = ListItem(List=deconstruct_mesh_2.Vertices, Index=deconstruct_face_2.CornerB, Wrap=True)
list_item_11 = ListItem(List=deconstruct_mesh_2.Vertices, Index=deconstruct_face_2.CornerC, Wrap=True)
list_item_12 = ListItem(List=deconstruct_mesh_3.Vertices, Index=deconstruct_face_3.CornerA, Wrap=True)
list_item_13 = ListItem(List=deconstruct_mesh_3.Vertices, Index=deconstruct_face_3.CornerB, Wrap=True)
list_item_14 = ListItem(List=deconstruct_mesh_3.Vertices, Index=deconstruct_face_3.CornerC, Wrap=True)
list_item_15 = ListItem(List=deconstruct_mesh_2.Vertices, Index=deconstruct_face_2.CornerD, Wrap=True)
list_item_16 = ListItem(List=deconstruct_mesh_3.Vertices, Index=deconstruct_face_3.CornerD, Wrap=True)
list_item_17 = ListItem(List=deconstruct_mesh_4.Vertices, Index=deconstruct_face_4.CornerA, Wrap=True)
list_item_18 = ListItem(List=deconstruct_mesh_4.Vertices, Index=deconstruct_face_4.CornerB, Wrap=True)
list_item_19 = ListItem(List=deconstruct_mesh_4.Vertices, Index=deconstruct_face_4.CornerC, Wrap=True)
list_item_20 = ListItem(List=deconstruct_mesh_4.Vertices, Index=deconstruct_face_4.CornerD, Wrap=True)
_4point_surface = _4PointSurface(CornerA=list_item_5, CornerB=list_item_6, CornerC=list_item_7, CornerD=list_item_9)
_4point_surface_2 = _4PointSurface(CornerA=list_item_8, CornerB=list_item_10, CornerC=list_item_11, CornerD=list_item_15)
_4point_surface_3 = _4PointSurface(CornerA=list_item_12, CornerB=list_item_13, CornerC=list_item_14, CornerD=list_item_16)
_4point_surface_4 = _4PointSurface(CornerA=list_item_17, CornerB=list_item_18, CornerC=list_item_19, CornerD=list_item_20)
area = Area(Geometry=_4point_surface)  # -> Area, Centroid
merge_all_100mm_blocks = Merge(
    Data1=explode_tree.Branch5,
    Data2=explode_tree.Branch6,
    Data3=explode_tree.Branch7,
    Data4=explode_tree.Branch8,
    Data5=explode_tree.Branch9,
    Data6=explode_tree.Branch10,
    Data7=explode_tree.Branch11,
    Data8=explode_tree.Branch12,
    Data9=explode_tree.Branch13,
    Data10=explode_tree.Branch14,
    Data11=explode_tree.Branch15,
    Data12=explode_tree.Branch16,
    Data13=explode_tree.Branch17,
    Data14=explode_tree.Branch18,
    Data15=explode_tree.Branch19)
deconstruct_mesh_5 = DeconstructMesh(Mesh=merge_all_100mm_blocks)  # -> Vertices, Faces, Colours, Normals
list_item_21 = ListItem(List=deconstruct_mesh_5.Faces, Index=Slider(5, range=0..5), Wrap=True)
deconstruct_face_5 = DeconstructFace(Face=list_item_21)  # -> CornerA, CornerB, CornerC, CornerD
list_item_22 = ListItem(List=deconstruct_mesh_5.Vertices, Index=deconstruct_face_5.CornerA, Wrap=True)
list_item_23 = ListItem(List=deconstruct_mesh_5.Vertices, Index=deconstruct_face_5.CornerB, Wrap=True)
list_item_24 = ListItem(List=deconstruct_mesh_5.Vertices, Index=deconstruct_face_5.CornerC, Wrap=True)
list_item_25 = ListItem(List=deconstruct_mesh_5.Vertices, Index=deconstruct_face_5.CornerD, Wrap=True)
_4point_surface_5 = _4PointSurface(CornerA=list_item_22, CornerB=list_item_23, CornerC=list_item_24, CornerD=list_item_25)
area_2 = Area(Geometry=_4point_surface_5)  # -> Area, Centroid
area_3 = Area(Geometry=_4point_surface_2)  # -> Area, Centroid
area_4 = Area(Geometry=_4point_surface_3)  # -> Area, Centroid
area_5 = Area(Geometry=_4point_surface_4)  # -> Area, Centroid
center_box = CenterBox(Base=area_2.Centroid, X="0.31", Y="0.31", Z="0.06")
center_box_2 = CenterBox(Base=area.Centroid, X="0.31", Y="0.31", Z="0.08")
center_box_3 = CenterBox(Base=area_3.Centroid, X="0.31", Y="0.31", Z="0.11")
center_box_4 = CenterBox(Base=area_4.Centroid, X="0.31", Y="0.31", Z="0.16")
center_box_5 = CenterBox(Base=area_5.Centroid, X="0.31", Y="0.31", Z="0.16")
merge = Merge(Data1=center_box_5, Data2=center_box_4, Data3=center_box_3, Data4=center_box_2, Data5=center_box)

# ----
merge_2 = Merge(
    Data1=explode_tree.Branch1,
    Data2=explode_tree.Branch2,
    Data3=explode_tree.Branch3,
    Data4=explode_tree.Branch4,
    Data5=explode_tree.Branch5,
    Data6=explode_tree.Branch6,
    Data7=explode_tree.Branch7,
    Data8=explode_tree.Branch8,
    Data9=explode_tree.Branch9,
    Data10=explode_tree.Branch10,
    Data11=explode_tree.Branch11,
    Data12=explode_tree.Branch12,
    Data13=explode_tree.Branch13,
    Data14=explode_tree.Branch14,
    Data15=explode_tree.Branch15,
    Data16=explode_tree.Branch16,
    Data17=explode_tree.Branch17,
    Data18=explode_tree.Branch18,
    Data19=explode_tree.Branch19)

# ---- group: Making truss lines
volume_2 = Volume(Geometry=merge_2)  # -> Volume, flatten(Centroid)
volume_3 = Volume(Geometry=sort_list.ValuesValuesA)  # -> Volume, Centroid
mesh_inclusion = MeshInclusion(Mesh=merge, Point=volume_2.Centroid, Strict=False)
dispatch = Dispatch(List=volume_2.Centroid, DispatchPattern=mesh_inclusion)  # -> ListA, ListB
point = Point(dispatch.ListA)
deconstruct_2 = Deconstruct(Point=point)  # -> XComponent, YComponent, ZComponent
construct_point = ConstructPoint(XCoordinate=deconstruct_2.XComponent, YCoordinate=deconstruct_2.YComponent, ZCoordinate=deconstruct_2.ZComponent)
line = Line(StartPoint=graft(volume_3.Centroid), EndPoint=construct_point)  # -> flatten(Line)
curve = Curve(line)
remove_duplicate_lines_karamba3d = RemoveDuplicateLinesKaramba3D(Line=line, LimitDistance=0.01)  # -> OutLine, Info, Indexes

# ---- group: Supports
end_points = EndPoints(Curve=remove_duplicate_lines_karamba3d.OutLine)  # -> Start, End
cull_duplicates = CullDuplicates(Points=end_points.End, Tolerance=1e-06, CullMode=3)  # -> flatten(Points), Indices, Valence
delete_consecutive_2 = DeleteConsecutive(Set=end_points.Start, Wrap=False)  # -> flatten(Set), Count
cull_duplicates_2 = CullDuplicates(Points=[cull_duplicates.Points, delete_consecutive_2.Set], Tolerance=1e-06, CullMode=3)  # -> flatten(Points), Indices, Valence
deconstruct_3 = Deconstruct(Point=cull_duplicates_2.Points)  # -> XComponent, YComponent, ZComponent
sort_list_2 = SortList(Keys=deconstruct_3.ZComponent, ValuesValuesA=cull_duplicates_2.Points)  # -> Keys, ValuesValuesA
expression = Expression(x=sort_list_2.Keys, Expression="If(x=0.25, true, false)")
dispatch_2 = Dispatch(List=sort_list_2.ValuesValuesA, DispatchPattern=expression)  # -> ListA, ListB
point_2 = Point(dispatch_2.ListA)
support_karamba3d = SupportKaramba3D(PosInd=point_2, menu=[buttons(on, on, on, off, off, off)])

# ---- group: Making beams with material
shear_modulus = Panel("4")
material_density_kn_m3 = Panel("15")
youngs_modulus = Panel("11")
material_properties_karamba3d = MaterialPropertiesKaramba3D(
    FamilyOfMaterial="Earth blocks",
    Name="Adobe",
    YoungsModulus_kN_cm2=youngs_modulus,
    InPlaneShearModulus_kN_cm2=shear_modulus,
    TransverseShearModulus_kN_cm2=shear_modulus,
    SpecificWeight_kN_m3=material_density_kn_m3,
    CoefficientOfThermalExpansion_1_C=1e-05,
    YieldStrength_kN_cm2=23.5,
    mode="Isotrop")
square_size_in_cm = Panel("15")
cross_section = CrossSectionKaramba3D(
    FamilyNameOfCrossSection="DefaultCroSec",
    Material=material_properties_karamba3d,
    Height_cm=square_size_in_cm,
    UpperFlangeWidth_cm=square_size_in_cm,
    LowerFlangeWidth_cm=square_size_in_cm,
    mode="Trapezoid")
line_to_beam_karamba3d = LineToBeamKaramba3D(Line=remove_duplicate_lines_karamba3d.OutLine, CrossSection=cross_section, New=True, Remove=True, LimitDistance_m=0.005)  # -> Element, Points, Info

# ---- group: Gravity
sf = Panel("-1.35")
unit_z = UnitZ(Factor=sf)
loads_karamba3d = LoadsKaramba3D(Vector=unit_z, LCase=0, mode="Gravity")

# ---- group: Analyse truss module
assemble_model_karamba3d = AssembleModelKaramba3D(
    Point=cull_duplicates_2.Points,
    Elem=line_to_beam_karamba3d.Element,
    Support=support_karamba3d,
    Load=loads_karamba3d,
    CrossSection=cross_section,
    LimitDistance_m=0.005)  # -> Model, Info, Mass_kg, CenterOfGravity
analyze = AnalyzeKaramba3D(Model=assemble_model_karamba3d.Model)  # -> CalculatedModel, MaximumDisplacement_cm, ResultingForceOfGravity_kN, ElasticEnergy_kNm
beam_view_karamba3d = BeamViewKaramba3D(Model=analyze.CalculatedModel)  # -> Model, MeshesOfRenderedBeams, DeformedBeamAxes, LegendColors, LegendTags
legend = Legend(
    Colour=beam_view_karamba3d.LegendColors,
    Tags=beam_view_karamba3d.LegendTags,
    Rectangle={Plane=PlaneXY(-12.49104186, 20.02327199, 0), Size=Domain2(u=-0.3945620632..0.3945620632, v=-1.197777692..1.197777692)},
    LegendType=1)
utilization_of_elements_karamba3d = UtilizationOfElementsKaramba3D(
    AnalyzedModel=beam_view_karamba3d.Model,
    ResultCase=-1,
    NumberOfSamplePoints=3,
    ElasticDesign=True,
    GammaM0=1,
    GammaM1=1,
    WithDetails=False,
    mode="Beams")  # -> AnalyzedModel, Utilization, SigMax_kN_cm2, SigMin_kN_cm2, TauMax_kN_cm2, UtilN, UtilVy, UtilVz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
sort_list_3 = SortList(Keys=[utilization_of_elements_karamba3d.SigMax_kN_cm2, utilization_of_elements_karamba3d.SigMin_kN_cm2])  # -> Keys, ValuesValuesA
max_compression_and_tensile = Panel(sort_list_3.Keys)
